# Grasshopper definition extended_type.gh (Grasshopper 1.0.7)
# plug-ins: RoslynScript

brep = Brep(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)
mesh = Mesh(brep)
csx = GhxCSharpScript(
    ICMesh=mesh,
    source="E:\Application\Graphics\3d\Modeleur\Rhino\Développement\Rex\Ghx.CSharpScript\test\extended_type\extended_type.csx",
    m_inconnector_ICMesh=csx,
    m_outconnector_result=csx)
csx_2 = GhxCSharpScript(
    ICMesh=mesh,
    source="E:\Application\Graphics\3d\Modeleur\Rhino\Développement\Rex\Ghx.CSharpScript\test\extended_type\extended_type.csx",
    m_inconnector_ICMesh=csx_2,
    m_outconnector_result=csx_2)
csx_3 = GhxCSharpScript(
    ICMesh=mesh,
    source="E:\Application\Graphics\3d\Modeleur\Rhino\Développement\Rex\Ghx.CSharpScript\test\extended_type\extended_type.csx",
    m_inconnector_ICMesh=csx_3,
    m_outconnector_result=csx_3)
panel = Panel([csx, csx_2, csx_3])
