# Grasshopper definition brep.gh (Grasshopper 1.0.7)
# plug-ins: RoslynScript

srf = Surface(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)
brep = Brep(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)
bbox = BoundingBox(Content=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, Plane=PlaneXY(0, 0, 0))  # -> Box, Box_2
csx = GhxCSharpScript(
    Brep=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,
    source="E:\Application\Graphics\3d\Modeleur\Rhino\Développement\Rex\Ghx.CSharpScript\test\input_output\brep.csx",
    m_inconnector_brep=csx,
    m_outconnector_result=csx)
panel = Panel(csx)
geo = Geometry(csx)
