# Grasshopper definition input_output.gh (Grasshopper 1.0.7)
# plug-ins: RoslynScript

clock = Clock(SecondHand=True)
mesh = Mesh(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)
bbox = BoundingBox(Content=mesh, Plane=PlaneXY(0, 0, 0))  # -> Box, Box_2
Z = UnitZ(Factor=1)
srf = Surface(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)
pln = Plane(Plane(origin=(14, 15, 0), x=(-0.7233555441, 0.6904757467, 0), y=(0.6138153706, 0.643044674, 0.4579565897)))
vec = Vector(Vector(11, -8, 0))
dim = Dimensions(Surface=srf)  # -> UDimension, VDimension
move = Move(Motion=Z)  # -> Geometry, Transform
arc = CircularArc({Angle=0, Angle=3.141592654, Plane=Plane(origin=(15, 5, 0), x=(-1, 0, 0), y=(0, -1, 0)), Radius=2})
crv = Curve(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)
int = Integer("30")
pt = Point(Point(8, 0, 0))
num = Number("30")
rec = Rectangle({Plane=PlaneXY(14, -6.5, 0), Size=Domain2(u=-1..1, v=-1.5..1.5)})
line = Line(Line((10, -2, 0), (10, 1, 0)))
circle = Circle({Plane=PlaneXY(10, 5, 0), Radius=2})
id = Guid(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)
crv_2 = Curve(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)
brep = Brep(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)
csx = GhxCSharpScript(
    TBool=Toggle(False),
    TString="30",
    TInteger=int,
    TDouble=num,
    TDate=clock,
    TColor=ColourSwatch(SwatchColor=RGB(255, 255, 255)),
    TGuid=id,
    TPoint=pt,
    TVector=vec,
    TPlane=pln,
    TInterval=dim.UDimension,
    TRectangle3d=rec,
    TBox=bbox.Box,
    TTransform=move.Geometry,
    TLine=line,
    TCircle=circle,
    TArc=arc,
    TPolyline=crv_2,
    TCurve=crv,
    TSurface=srf,
    TBrep=brep,
    TMesh=mesh,
    GeometryBase=mesh,
    source="E:\Application\Graphics\3d\Modeleur\Rhino\Développement\Rex\Ghx.CSharpScript\test\input_output\input_output.csx",
    m_inconnector_GeometryBase=csx,
    m_inconnector_tArc=csx,
    m_inconnector_tBool=csx,
    m_inconnector_tBox=csx,
    m_inconnector_tBrep=csx,
    m_inconnector_tCircle=csx,
    m_inconnector_tColor=csx,
    m_inconnector_tCurve=csx,
    m_inconnector_tDate=csx,
    m_inconnector_tDouble=csx,
    m_inconnector_tGuid=csx,
    m_inconnector_tInteger=csx,
    m_inconnector_tInterval=csx,
    m_inconnector_tLine=csx,
    m_inconnector_tMesh=csx,
    m_inconnector_tPlane=csx,
    m_inconnector_tPoint=csx,
    m_inconnector_tPolyline=csx,
    m_inconnector_tRectangle3d=csx,
    m_inconnector_tString=csx,
    m_inconnector_tSurface=csx,
    m_inconnector_tTransform=csx,
    m_inconnector_tVector=csx,
    m_outconnector_OArc=csx,
    m_outconnector_OBollean=csx,
    m_outconnector_OBox=csx,
    m_outconnector_OBrep=csx,
    m_outconnector_OCircle=csx,
    m_outconnector_OColor=csx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)  # -> OBollean, OInteger, ODouble, OString, ODateTime, OGuid, OColor, OPoint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
panel = Panel(csx.OBrep)
panel_2 = Panel([csx.OBollean, csx.OInteger, csx.ODouble, csx.OString, csx.ODateTime, csx.OGuid, csx.OColor, csx.OPoint, csx.OVector, csx.OPlane, csx.OInterval, csx.ORectangel, csx.OBox, csx.OTransform, csx.OLine, csx.OCircle, csx.OArc, csx.OPolyline, csx.OCurv, csx.OSurface, csx.OBrep])
mesh_2 = Mesh()
