# Grasshopper definition list_access.gh (Grasshopper 1.0.7)
# plug-ins: RoslynScript

panel = Panel("""1
2""")
merge = Merge(Data1=graft(Toggle(False)), Data2=graft(Toggle(False)))
merge_2 = Merge(Data1=graft(panel), Data2=graft("3"))
panel_2 = Panel(merge)
csx = GhxCSharpScript(
    Active=merge,
    Datas=merge_2,
    source="E:\Application\Graphics\3d\Modeleur\Rhino\Développement\Rex\Ghx.CSharpScript\test\input_output\list_access.csx",
    m_inconnector_Datas=csx,
    m_inconnector_active=csx,
    m_outconnector_result=csx)
panel_3 = Panel(merge_2)
