# Grasshopper definition sort_parameters.gh (Grasshopper 1.0.7)
# plug-ins: RoslynScript

csx = GhxCSharpScript(
    O1="1",
    O2="2",
    O3="3",
    O4="4",
    source="E:\Application\Graphics\3d\Modeleur\Rhino\Développement\Rex\Ghx.CSharpScript\test\input_output\sort_parameters.csx",
    m_inconnector_o1=csx,
    m_inconnector_o2=csx,
    m_inconnector_o3=csx,
    m_inconnector_o4=csx,
    m_outconnector_O1=csx,
    m_outconnector_O2=csx,
    m_outconnector_O3=csx,
    m_outconnector_O4=csx)  # -> O1, O2, O3, O4
panel = Panel(csx.O1)
panel_2 = Panel(csx.O2)
panel_3 = Panel(csx.O3)
panel_4 = Panel(csx.O4)
